# Grasshopper definition HVACSystemWorkflow.gh (Grasshopper 0.9.76)
# plug-ins: Python Interpreter, Ironbug.Grasshopper

number_slider = Slider(0.7, range=0..1)
brep = Brep([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])
honeybee = Honeybee_Honeybee()  # -> Vviiiiiiiiiizzz; plug-in component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
ladybug = Ladybug_Ladybug()  # -> Vviiiiiiiiiizzz; plug-in component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
intersectmass = Honeybee_IntersectMassII(Breps_=brep)
glzparamlist = Honeybee_GlazingParametersList(northGlzParam=0, westGlzParam=0, southGlzParam=number_slider, eastGlzParam=number_slider)  # -> glzParamList; plug-in component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
mass2zone = Honeybee_Masses2Zones(zoneMasses=flatten(intersectmass), maxRoofAngle=30, createHBZones=Toggle(True))  # -> readMe, HBZones; plug-in component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
panel = Panel("https://www.energyplus.net/weather-download/north_and_central_america_wmo_region_4/USA/NY/USA_NY_New.York-LaGuardia.AP.725030_TMY3/all")
boiler = Ironbug_BoilerHotWater()
solveadjc = Honeybee_SolveAdjacencies(HBZones=flatten(mass2zone.HBZones), removeCurrentAdjc=False, findAdjc=Toggle(True))  # -> readMe, HBZonesWADJ; plug-in component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
glazingcreator = Honeybee_GlazingBasedOnRatio(HBObjects=solveadjc.HBZonesWADJ, glzRatio=glzparamlist, runIt=Toggle(True))  # -> readMe, HBObjWGLZ; plug-in component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
epw_stat = Ladybug_OpenEPWAndSTATWeatherFiles(weatherFileURL=panel)  # -> epwFile, statFile; plug-in component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
# HB_Zones
data = Data(flatten(glazingcreator.HBObjWGLZ))
# HBZones
brep_2 = Brep(flatten(data))

# ----
# Sys07_VAV_Reheat
# Airloop
panel_2 = Panel("DifferentialDryBulb")
lng = ListLength(List=brep_2)
coilhtnwater = Ironbug_CoilHeatingWater()  # -> AirSide_CoilHeatingWater, WaterSide_CoilHeatingWater
objparams = Ironbug_ObjParams(EconomizerControlType=panel_2, DataFieldSetType="Ironbug.HVAC.IB_ControllerOutdoorAir_FieldSet")
duplicate = Ironbug_Duplicate(Reference=coilhtnwater.AirSide_CoilHeatingWater, Amount=lng)  # -> Objects, WaterSide_CoilHeatingWater
objparams_2 = Ironbug_ObjParams(PressureRise="500", DataFieldSetType="Ironbug.HVAC.IB_FanVariableVolume_FieldSet")
oacontroller = Ironbug_OAController(Parameters_=objparams)
objparams_3 = Ironbug_ObjParams(
    AllOutdoorAirinCooling=Toggle(False),
    AllOutdoorAirinHeating=Toggle(False),
    CentralHeatingDesignSupplyAirTemperature="12.8",
    DataFieldSetType="Ironbug.HVAC.IB_SizingSystem_FieldSet")
vavreheat = Ironbug_AirTerminalSingleDuctVAVReheat(HeatingCoil=duplicate.Objects)
coilclnwater = Ironbug_CoilCoolingWater()  # -> AirSide_CoilCoolingWater, WaterSide_CoilCoolingWater
coilhtnwater_2 = Ironbug_CoilHeatingWater()  # -> AirSide_CoilHeatingWater, WaterSide_CoilHeatingWater
oasystem = Ironbug_OutdoorAirSystem(Controller_=oacontroller)
thermalzone = Ironbug_ThermalZone(HoneybeeZonesOrOsZones=brep_2, AirTerminal_=vavreheat, IsAirTerminalPriorToZoneEquipments=True)
fanvariable = Ironbug_FanVariableVolume(Parameters=objparams_2)
spm_scheduled = Ironbug_SetpointManagerScheduled(Temperature="12.8")
branches = AirLoopBranches(Branch1=thermalzone)
sizingsystem = Ironbug_SizingSystem(Parameters_=objparams_3)
merge = Merge(
    Data1=oasystem,
    Data2=coilclnwater.AirSide_CoilCoolingWater,
    Data3=coilhtnwater_2.AirSide_CoilHeatingWater,
    Data4=fanvariable,
    Data5=spm_scheduled)
airloop = Ironbug_AirLoopHVAC(Supply=merge, Demand=branches, SizingSystem=sizingsystem)

graft = GraftTree(Tree=duplicate.WaterSide_CoilHeatingWater, IncludeEmptyLists=True, IncludeNullItems=True)

# ----
# Chilled water loop
chiller_watercooled = Ironbug_ChillerElectricEIR_WaterCooled()  # -> ChillerElectricEIR, ChillerElectricEIR_CondenserLoop
pumpvariable = Ironbug_PumpVariableSpeed()
branches_2 = PlantBranches(Branch1=chiller_watercooled.ChillerElectricEIR)
spm_scheduled_2 = Ironbug_SetpointManagerScheduled(Temperature="6.7")
branches_3 = PlantBranches(Branch1=coilclnwater.WaterSide_CoilCoolingWater)
cwloop = Ironbug_ChilledWaterPlantLoop(Supply=[pumpvariable, branches_2, spm_scheduled_2], Demand=branches_3)

# ----
# Condenser water loop
coolingtower1 = Ironbug_CoolingTowerSingleSpeed()
pipeadiabatic = Ironbug_PipeAdiabatic()
spm_followoatemp = Ironbug_SetpointManagerFollowOutdoorAirTemperature(MaximumSetpointTemperature="80", MinimumSetpointTemperature="6", OffsetTemperatureDifference="1.5")
pumpvariable_2 = Ironbug_PumpVariableSpeed()
plantbranches = PlantBranches(Branch1=chiller_watercooled.ChillerElectricEIR_CondenserLoop)
branches_4 = PlantBranches(B1=coolingtower1, B2=pipeadiabatic)
dwloop = Ironbug_CondenserWaterPlantLoop(Supply=[pumpvariable_2, branches_4, spm_followoatemp], Demand=plantbranches)

# ----
# Hot water loop
panel_3 = Panel("67")
pumpvariable_3 = Ironbug_PumpVariableSpeed()
plantbranches_2 = PlantBranches(Branch1=boiler)
spm_scheduled_3 = Ironbug_SetpointManagerScheduled(Temperature=panel_3)
branches_5 = PlantBranches(B1=graft, B2=coilhtnwater_2.WaterSide_CoilHeatingWater)
hwloop = Ironbug_HotWaterPlantLoop(Supply=[pumpvariable_3, plantbranches_2, spm_scheduled_3], Demand=branches_5)

hvacsystemslist = Honeybee_HVACSystemsList({"-1. Thermostat Only": -1, "0. Ideal Air Loads": 0, "1. PTAC | Residential": 1, "2. PTHP | Residential": 2, "3. Packaged Single Zone - AC": 3, "4. Packaged Single Zone - HP": 4, "5. Packaged VAV w/ Reheat": 5, "6. Packaged VAV w/ PFP Boxes": 6, "7. VAV w/ Reheat": 7, "8. VAV w/ PFP Boxes": 8, "9. Warm Air Furnace - Gas Fired": 9, "10.Warm Air Furnace - Electric": 10, "11.Fan Coil Units + DOAS": 11, "12.Active Chilled Beams + DOAS": 12, "13.Radiant Floors + DOAS": 13, "14.Custom Rad Surfaces + DOAS": 14, "15.Heated Surfaces + VAV Cooling": 15, "16.VRF + DOAS": 16, "17.WSHP + DOAS": 17}, selected="12.Active Chilled Beams + DOAS")
merge_2 = Merge(Data1=hwloop, Data2=cwloop, Data3=dwloop)
hvacsystem = Ironbug_HVACSystem(AirLoops=flatten(airloop), PlantLoops=flatten(merge_2))

# ----
# With Honeybee_Assign HVAC System Templates
hvacsystem_2 = Honeybee_AssignHVACSystem(HBZones=data, HVACSystems=hvacsystemslist)  # -> readMe, HBZones; plug-in component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
toggle = BooleanToggle(False)
exporttoopenstudio = Honeybee_ExportToOpenStudio(
    epwWeatherFile=epw_stat.epwFile,
    HBZones=flatten(hvacsystem_2.HBZones),
    writeOSM=toggle,
    openOpenStudio=toggle,
    fileName="HB_SYS")  # -> readMe, osmFileAddress, idfFileAddress, resultFileAddress, eioFileAddress, rddFileAddress, htmlReport, studyFolder, model; plug-in component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

toggle_2 = BooleanToggle(False)
# HBZones
brep_3 = Brep(flatten(data))

readepresult = Honeybee_ReadEPResult()  # -> totalThermalLoad, thermalLoadBalance, cooling, heating, electricLight, electricEquip, fanElectric, pumpElectric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; plug-in component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
strnum = Ladybug_SeparateData(inputList=flatten(readepresult.cooling))  # -> numbers, strings; plug-in component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
strnum_2 = Ladybug_SeparateData(inputList=flatten(readepresult.heating))  # -> numbers, strings; plug-in component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
ma = MassAddition(Input=flatten(strnum.numbers))  # -> Result, PartialResults
ma_2 = MassAddition(Input=strnum_2.numbers)  # -> Result, PartialResults
panel_4 = Panel(ma.Result)
panel_5 = Panel(ma_2.Result)

objparams_4 = Ironbug_ObjParams(CooledBeamType="Active", DataFieldSetType="Ironbug.HVAC.IB_AirTerminalSingleDuctConstantVolumeCooledBeam_FieldSet")

# ----
# Chilled Beam + Baseboard
coil_cooledbeam = Ironbug_CoilCoolingCooledBeam()  # -> CoilCoolingCooledBeam, WaterSide_CoilCoolingWater
lng_2 = ListLength(List=brep_3)
coilhtn_baseboard = Ironbug_CoilHeatingWaterBaseboard()  # -> CoilHeatingWaterBaseboard, WaterSide_CoilHeatingWater
duplicate_2 = Ironbug_Duplicate(Reference=coil_cooledbeam.CoilCoolingCooledBeam, Amount=lng_2)  # -> Objects, WaterSide_CoilCoolingWater
duplicate_3 = Ironbug_Duplicate(Reference=coilhtn_baseboard.CoilHeatingWaterBaseboard, Amount=lng_2)  # -> Objects, WaterSide_CoilHeatingWater
baseboardwaterc = Ironbug_ZoneHVACBaseboardConvectiveWater(CoilHeatingWaterBaseboard=duplicate_3.Objects)
chilledbeam = Ironbug_AirTerminalChilledBeam(CoolingCoil=duplicate_2.Objects, Parameters_=objparams_4)
thermalzone_2 = Ironbug_ThermalZone(
    HoneybeeZonesOrOsZones=brep_3,
    AirTerminal_=chilledbeam,
    ZoneEquipment=baseboardwaterc,
    IsAirTerminalPriorToZoneEquipments=True)

panel_6 = Panel("This is an example for building OpenStudio HVAC system with Ironbug")
panel_7 = Panel("""Honeybee
Ironbug
HVAC""")
exporthydra = Hydra_ExportFile(
    fileName="Ironbug_HVAC 07 VAV Reheat",
    fileDescription=panel_6,
    fileTags=panel_7,
    targetFolder="C:\Users\mingo\Documents\GitHub\hydra",
    GHForThumb=Toggle(True),
    export=Button())  # -> readMe; inputs fileDescription: list, changeLog: list, fileTags: list, includeRhino: Boolean, GHForThumb: Boolean, additionalImgs: list, export: Boolean; plug-in component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

# ----
# ADEG Water Chiller
cluster = Cluster()  # -> cvbiquadratic, cvbiquadratic_2, curve
chillerelec_adv = Ironbug_ChillerElectricEIR_Advanced(
    CoolingCapacityFunctionOfTemperatureCurve=cluster.cvbiquadratic,
    ElectricInputToCoolingOutputRatioFunctionOfTemperatureCurve=cluster.cvbiquadratic_2,
    ElectricInputToCoolingOutputRatioFunctionOfPartLoadRatioCurve=cluster.curve)  # -> ChillerElectricEIR, ChillerElectricEIR_CondenserLoop

objparams_5 = Ironbug_ObjParams(
    Coefficient2OfthePartLoadPerformanceCurve="0.0216",
    Coefficient3OfthePartLoadPerformanceCurve="-0.0325",
    Coefficient4OfthePartLoadPerformanceCurve="1.0095",
    RatedPumpHead="134508",
    DataFieldSetType="Ironbug.HVAC.IB_PumpVariableSpeed_FieldSet")
objparams_6 = Ironbug_ObjParams(
    Coefficient2OfthePartLoadPerformanceCurve="0.0216",
    Coefficient3OfthePartLoadPerformanceCurve="-0.0325",
    Coefficient4OfthePartLoadPerformanceCurve="1.0095",
    RatedPumpHead="119563",
    DataFieldSetType="Ironbug.HVAC.IB_PumpVariableSpeed_FieldSet")
objparams_7 = Ironbug_ObjParams(
    EconomizerLockout=Toggle(False),
    FrostControlType="ExhaustOnly",
    InitialDefrostTimeFraction="0.1670",
    RateofDefrostTimeFractionIncrease="0.024",
    ThresholdTemperature="-12.2",
    DataFieldSetType="Ironbug.HVAC.IB_HeatExchangerAirToAirSensibleAndLatent_FieldSet")
objparams_8 = Ironbug_ObjParams(PressureRise="500", DataFieldSetType="Ironbug.HVAC.IB_FanVariableVolume_FieldSet")
heatexchanger_air = Ironbug_HeatExchangerAirToAirSensibleAndLatent(Parameters_=objparams_7)
hvactemplate = Ironbug_HVACTemplate()

# ----
# Condenser water loop
coolingtowerv = Ironbug_CoolingTowerVariableSpeed()
pipeadiabatic_2 = Ironbug_PipeAdiabatic()
spm_followoatemp_2 = Ironbug_SetpointManagerFollowOutdoorAirTemperature()
pumpvariable_4 = Ironbug_PumpVariableSpeed(Parameters=objparams_5)
plantbranches_3 = PlantBranches(Branch1=chillerelec_adv.ChillerElectricEIR_CondenserLoop)
branches_6 = PlantBranches(B1=coolingtowerv, B2=pipeadiabatic_2)
dwloop_2 = Ironbug_CondenserWaterPlantLoop(Supply=[pumpvariable_4, branches_6, spm_followoatemp_2], Demand=plantbranches_3)

coilclnwater_2 = Ironbug_CoilCoolingWater()  # -> AirSide_CoilCoolingWater, WaterSide_CoilCoolingWater

# ----
# Chilled water loop
graft_2 = GraftTree(Tree=duplicate_2.WaterSide_CoilCoolingWater, IncludeEmptyLists=True, IncludeNullItems=True)
objparams_9 = Ironbug_ObjParams(
    DesignLoopExitTemperature="6.7",
    LoopDesignTemperatureDifference="6.7",
    LoopType="Cooling",
    DataFieldSetType="Ironbug.HVAC.IB_SizingPlant_FieldSet")
pumpvariable_5 = Ironbug_PumpVariableSpeed(Parameters=objparams_6)
branches_7 = PlantBranches(B1=graft_2, B2=coilclnwater_2.WaterSide_CoilCoolingWater)
branches_8 = PlantBranches(Branch1=chillerelec_adv.ChillerElectricEIR)
spm_scheduled_4 = Ironbug_SetpointManagerScheduled(Temperature="6.7")
sizingplant = Ironbug_SizingPlant(Parameters_=objparams_9)
cwloop_2 = Ironbug_ChilledWaterPlantLoop(Supply=[pumpvariable_5, branches_8, spm_scheduled_4], Demand=branches_7, SizingLoop=sizingplant)

coilhtnwater_3 = Ironbug_CoilHeatingWater()  # -> AirSide_CoilHeatingWater, WaterSide_CoilHeatingWater

# ----
# DOAS
panel_8 = Panel("VentilationRequirement")
objparams_10 = Ironbug_ObjParams(
    CentralHeatingDesignSupplyAirTemperature="40",
    MinimumSystemAirFlowRatio="1",
    TypeofLoadtoSizeOn=panel_8,
    DataFieldSetType="Ironbug.HVAC.IB_SizingSystem_FieldSet")
oasystem_2 = Ironbug_OutdoorAirSystem(HeatRecovery_=heatexchanger_air)
airloopbranches = AirLoopBranches(Branch1=thermalzone_2)
fanvariable_2 = Ironbug_FanVariableVolume(Parameters_=objparams_8)
spm_scheduled_5 = Ironbug_SetpointManagerScheduled(Temperature="20")
objparams_11 = Ironbug_ObjParams(Name="DOAS", DataFieldSetType="Ironbug.HVAC.IB_AirLoopHVAC_FieldSet")
sizingsystem_2 = Ironbug_SizingSystem(Parameters_=objparams_10)
merge_3 = Merge(
    Data1=oasystem_2,
    Data2=coilclnwater_2.AirSide_CoilCoolingWater,
    Data3=coilhtnwater_3.AirSide_CoilHeatingWater,
    Data4=fanvariable_2,
    Data5=spm_scheduled_5)
airloop_2 = Ironbug_AirLoopHVAC(Supply=merge_3, Demand=airloopbranches, SizingSystem=sizingsystem_2, Parameters_=objparams_11)

# ----
# Hot water loop
panel_9 = Panel("0.9")
graft_3 = GraftTree(Tree=duplicate_3.WaterSide_CoilHeatingWater, IncludeEmptyLists=True, IncludeNullItems=True)
pumpvariable_6 = Ironbug_PumpVariableSpeed(Parameters=objparams_6)
spm_scheduled_6 = Ironbug_SetpointManagerScheduled(Temperature="67")
branches_9 = PlantBranches(B1=graft_3, B2=coilhtnwater_3.WaterSide_CoilHeatingWater)

objparams_12 = Ironbug_ObjParams(NominalThermalEfficiency=panel_9, DataFieldSetType="Ironbug.HVAC.IB_BoilerHotWater_FieldSet")

boiler_2 = Ironbug_BoilerHotWater(Parameters_=objparams_12)
plantbranches_4 = PlantBranches(Branch1=boiler_2)
hwloop_2 = Ironbug_HotWaterPlantLoop(Supply=[pumpvariable_6, plantbranches_4, spm_scheduled_6], Demand=branches_9)

merge_4 = Merge(Data1=hwloop_2, Data2=cwloop_2, Data3=dwloop_2)
hvacsystem_3 = Ironbug_HVACSystem(AirLoops=flatten(airloop_2), PlantLoops=flatten(merge_4))
# With Ironbug HVACTemplates
exporttoopenstudio_2 = Honeybee_ExportToOpenStudio(
    epwWeatherFile=epw_stat.epwFile,
    HBZones=flatten(data),
    HVACSystem=flatten(hvacsystem_3),
    writeOSM=toggle_2,
    openOpenStudio=toggle_2,
    fileName="IB_SYS")  # -> readMe, osmFileAddress, idfFileAddress, resultFileAddress, eioFileAddress, rddFileAddress, htmlReport, studyFolder, model; plug-in component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

readepresult_2 = Honeybee_ReadEPResult(resultFileAddress=exporttoopenstudio_2.resultFileAddress)  # -> totalThermalLoad, thermalLoadBalance, cooling, heating, electricLight, electricEquip, fanElectric, pumpElectric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; plug-in component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
strnum_3 = Ladybug_SeparateData(inputList=flatten(readepresult_2.cooling))  # -> numbers, strings; plug-in component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
strnum_4 = Ladybug_SeparateData(inputList=flatten(readepresult_2.heating))  # -> numbers, strings; plug-in component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
ma_3 = MassAddition(Input=flatten(strnum_3.numbers))  # -> Result, PartialResults
ma_4 = MassAddition(Input=strnum_4.numbers)  # -> Result, PartialResults
panel_10 = Panel(ma_3.Result)
panel_11 = Panel(ma_4.Result)

# ==== cluster Cluster
panel = Panel("""1.41E-01
6.55E-01
2.03E-01""")
objparams = Ironbug_ObjParams(MaximumValueofx="20", MaximumValueofy="50", DataFieldSetType="Ironbug.HVAC.Curves.IB_CurveBiquadratic_FieldSet")
objparams_2 = Ironbug_ObjParams(MaximumValueofx="20", MaximumValueofy="50", DataFieldSetType="Ironbug.HVAC.Curves.IB_CurveBiquadratic_FieldSet")
panel_2 = Panel("""4.68E-01
-1.38E-02
6.98E-04
1.09E-02
4.62E-04
-6.82E-04""")
objparams_3 = Ironbug_ObjParams(MaximumValueofx="1.2", DataFieldSetType="Ironbug.HVAC.Curves.IB_CurveQuadratic_FieldSet")
panel_3 = Panel("""1.07E+00
4.29E-02
4.17E-04
-8.10E-03
-4.02E-05
-3.86E-04""")
curvebiquadratic = Ironbug_CurveBiquadratic(Coefficients=panel_3, Parameters_=objparams)
cvbiquadratic = ClusterOutput(curvebiquadratic)
curvebiquadratic_2 = Ironbug_CurveBiquadratic(Coefficients=panel_2, Parameters_=objparams_2)
cvbiquadratic_2 = ClusterOutput(curvebiquadratic_2)
curvequadratic = Ironbug_CurveQuadratic(Coefficients=panel, Parameters_=objparams_3)
curve = ClusterOutput(curvequadratic)
